# Grasshopper definition tetraedro.gh (Grasshopper 1.0.7)

# https://web.archive.org/web/20170524211828/http://www.ict.griffith.edu.au/anthony/kites/tetra/straw_plan/
number_slider = Slider(1.5, range=0..10)
number_slider_2 = Slider(2, range=0..10)

# ---- group: Ponto 0.0.0
construct_point = ConstructPoint(XCoordinate=0, YCoordinate=0, ZCoordinate=0)  # disabled

# ---- group: Paramêtros
edge = Slider(3, range=0..20)  # disabled
tetrahedron_x = Slider(5, range=0..20)  # disabled
tetrahedron_y = Slider(3, range=0..20)  # disabled
tetrahedron_z = Slider(3, range=0..20)  # disabled
pipe_radius = Slider(0.044, range=0..20)  # disabled
sphere_radius = Slider(0.241, range=0..20)  # disabled

# ----
negative = Negative(Value=number_slider)
multiplication = Multiplication(A=number_slider, B=number_slider_2)
unit_x = UnitX(Factor=multiplication)
multiplication_2 = Multiplication(A=multiplication, B=number_slider_2)
negative_2 = Negative(Value=unit_x)
panel = Panel("3")  # disabled
panel_2 = Panel("6")  # disabled
panel_3 = Panel("3")  # disabled
deconstruct = Deconstruct(Point=construct_point)  # -> XComponent, YComponent, ZComponent; disabled
sqrt = SquareRoot(Value=panel)  # disabled
sqrt_2 = SquareRoot(Value=panel_2)  # disabled
sqrt_3 = SquareRoot(Value=panel_3)  # disabled
panel_4 = Panel("3")  # disabled
panel_5 = Panel("6")  # disabled
unit_z = UnitZ(Factor=multiplication_2)
division = Division(A=sqrt_2, B=panel_4)  # disabled
division_2 = Division(A=sqrt_3, B=panel_5)  # disabled
construct_point_2 = ConstructPoint(XCoordinate=number_slider, YCoordinate=number_slider, ZCoordinate=multiplication)
construct_point_3 = ConstructPoint(XCoordinate=negative, YCoordinate=number_slider, ZCoordinate=multiplication)
construct_point_4 = ConstructPoint(XCoordinate=0, YCoordinate=0, ZCoordinate=0)
construct_point_5 = ConstructPoint(XCoordinate=0, YCoordinate=multiplication, ZCoordinate=0)
move = Move(Geometry=construct_point_5, Motion=unit_x)  # -> Geometry, Transform
move_2 = Move(Geometry=construct_point_5, Motion=negative_2)  # -> Geometry, Transform
panel_6 = Panel("2")  # disabled
division_3 = Division(A=sqrt, B=panel_6)  # disabled
multiplication_3 = Multiplication(A=edge, B=division_3)  # disabled
division_4 = Division(A=edge, B=panel_6)  # disabled
multiplication_4 = Multiplication(A=edge, B=division_2)  # disabled
multiplication_5 = Multiplication(A=edge, B=division)  # disabled
construct_point_6 = ConstructPoint(XCoordinate=0, YCoordinate=0, ZCoordinate=0)  # disabled

# ---- group: P3
construct_point_7 = ConstructPoint(XCoordinate=division_4, YCoordinate=multiplication_3, ZCoordinate=0)  # disabled

# ----
panel_7 = Panel(construct_point_7)  # disabled

# ---- group: P4
construct_point_8 = ConstructPoint(XCoordinate=division_4, YCoordinate=multiplication_4, ZCoordinate=multiplication_5)  # disabled

# ----
panel_8 = Panel(construct_point_8)  # disabled

# ---- group: P2
construct_point_9 = ConstructPoint(XCoordinate=edge, YCoordinate=deconstruct.YComponent, ZCoordinate=deconstruct.ZComponent)  # disabled

# ----
panel_9 = Panel(construct_point_9)  # disabled

# ---- group: direita
line = Line(StartPoint=construct_point_2, EndPoint=construct_point_4)
line_2 = Line(StartPoint=construct_point_2, EndPoint=construct_point_5)

# ---- group: Eixo
line_3 = Line(StartPoint=construct_point_4, EndPoint=construct_point_5)

# ---- group: Esquerda
line_4 = Line(StartPoint=construct_point_3, EndPoint=construct_point_4)
line_5 = Line(StartPoint=construct_point_3, EndPoint=construct_point_5)

# ----
move_3 = Move(Geometry=construct_point_5, Motion=unit_z)  # -> Geometry, Transform
move_4 = Move(Geometry=move.Geometry, Motion=unit_z)  # -> Geometry, Transform
move_5 = Move(Geometry=move_2.Geometry, Motion=unit_z)  # -> Geometry, Transform

# ---- group: LINES
ln = Line(StartPoint=construct_point, EndPoint=construct_point_9)  # disabled
ln_2 = Line(StartPoint=construct_point, EndPoint=construct_point_7)  # disabled
ln_3 = Line(StartPoint=construct_point, EndPoint=construct_point_8)  # disabled
ln_4 = Line(StartPoint=construct_point_9, EndPoint=construct_point_7)  # disabled
ln_5 = Line(StartPoint=construct_point_9, EndPoint=construct_point_8)  # disabled
ln_6 = Line(StartPoint=construct_point_7, EndPoint=construct_point_8)  # disabled

# ----
planar = PlanarSrf(Edges=[line, line_2, line_3])
planar_2 = PlanarSrf(Edges=[line_4, line_5, line_3])
unit_y = UnitY(Factor=multiplication)

panel_10 = Panel("0")  # disabled
series = Series(Start=panel_10, Step=edge, Count=tetrahedron_x)  # disabled

# ---- group: Superfície
planar_3 = PlanarSrf(Edges=[ln_2, ln_3, ln_6])  # disabled
planar_4 = PlanarSrf(Edges=[ln_6, ln_4, ln_5])  # disabled

# ----
point = Point(construct_point_7)  # disabled
move_6 = Move(Geometry=planar, Motion=unit_y)  # -> Geometry, Transform
deconstruct_brep = DeconstructBrep(Brep=move_6.Geometry)  # -> Faces, Edges, Vertices
list_item = ListItem(List=deconstruct_brep.Vertices, Index=0, Wrap=True)  # -> Item, Item1, Item2
move_7 = Move(Geometry=planar_2, Motion=unit_y)  # -> Geometry, Transform
deconstruct_brep_2 = DeconstructBrep(Brep=move_7.Geometry)  # -> Faces, Edges, Vertices
list_item_2 = ListItem(List=deconstruct_brep_2.Vertices, Index=0, Wrap=True)  # -> Item, Item1, Item2
move_8 = Move(Geometry=[construct_point_2, construct_point_3, construct_point_5], Motion=unit_y)  # -> Geometry, Transform
move_9 = Move(Geometry=[line, line_2, line_4, line_5, line_3], Motion=unit_y)  # -> Geometry, Transform
X = UnitX(Factor=series)  # disabled
line_6 = Line(StartPoint=construct_point_3, EndPoint=move_3.Geometry)
line_7 = Line(StartPoint=move_3.Geometry, EndPoint=list_item_2.Item)
line_8 = Line(StartPoint=construct_point_3, EndPoint=list_item_2.Item)
line_9 = Line(StartPoint=move_3.Geometry, EndPoint=construct_point_2)
line_10 = Line(StartPoint=move_3.Geometry, EndPoint=list_item.Item)
line_11 = Line(StartPoint=list_item.Item, EndPoint=construct_point_2)
line_12 = Line(StartPoint=move_5.Geometry, EndPoint=construct_point_3)
line_13 = Line(StartPoint=move_5.Geometry, EndPoint=list_item_2.Item)

panel_11 = Panel("3")  # disabled
sqrt_4 = SquareRoot(Value=panel_11)  # disabled
multiplication_6 = Multiplication(A=sqrt_4, B=edge)  # disabled
panel_12 = Panel("0")  # disabled
series_2 = Series(Start=panel_12, Step=multiplication_6, Count=tetrahedron_y)  # disabled

# ---- group: MOV X
move_10 = Move(Geometry=graft(point), Motion=X)  # -> Geometry, Transform; disabled
move_11 = Move(Geometry=planar_3, Motion=X)  # -> Geometry, Transform; disabled
move_12 = Move(Geometry=planar_4, Motion=X)  # -> Geometry, Transform; disabled
move_13 = Move(Motion=X)  # -> Geometry, Transform; disabled

# ----
loft = Loft(
    Curves=[line_6, line_7, line_8],
    Options={Adjust=False, Closed=False, LoftEnds=0, LoftSimp=0, LoftType=0, Rebuild=10, Refit=0.01})
loft_2 = Loft(
    Curves=[line_13, line_12, line_8],
    Options={Adjust=False, Closed=False, LoftEnds=0, LoftSimp=0, LoftType=0, Rebuild=10, Refit=0.01})
Y = UnitY(Factor=series_2)  # disabled

panel_13 = Panel("3")  # disabled
sqrt_5 = SquareRoot(Value=panel_13)  # disabled
panel_14 = Panel("2")  # disabled
division_5 = Division(A=sqrt_5, B=panel_14)  # disabled
panel_15 = Panel("2")  # disabled
division_6 = Division(A=edge, B=panel_15)  # disabled
multiplication_7 = Multiplication(A=edge, B=division_5)  # disabled

# ---- group: MOV Y 1
move_14 = Move(Geometry=graft(move_10.Geometry), Motion=Y)  # -> Geometry, Transform; disabled
move_15 = Move(Geometry=graft(move_11.Geometry), Motion=Y)  # -> Geometry, Transform; disabled
move_16 = Move(Geometry=graft(move_13.Geometry), Motion=Y)  # -> Geometry, Transform; disabled
move_17 = Move(Geometry=graft(move_12.Geometry), Motion=Y)  # -> Geometry, Transform; disabled

# ----
vec = VectorXYZ(XComponent=division_6, YComponent=multiplication_7, ZComponent=0)  # -> Vector, Length; disabled

# ---- group: MOV Y 2
move_18 = Move(Geometry=move_14.Geometry, Motion=vec.Vector)  # -> Geometry, Transform; disabled
move_19 = Move(Geometry=move_16.Geometry, Motion=vec.Vector)  # -> Geometry, Transform; disabled
move_20 = Move(Geometry=move_15.Geometry, Motion=vec.Vector)  # -> Geometry, Transform; disabled
move_21 = Move(Geometry=move_17.Geometry, Motion=vec.Vector)  # -> Geometry, Transform; disabled

# ----
panel_16 = Panel("3")  # disabled
panel_17 = Panel("6")  # disabled
sqrt_6 = SquareRoot(Value=panel_16)  # disabled
panel_18 = Panel("6")  # disabled
panel_19 = Panel("3")  # disabled
sqrt_7 = SquareRoot(Value=panel_18)  # disabled
division_7 = Division(A=sqrt_6, B=panel_17)  # disabled
division_8 = Division(A=sqrt_7, B=panel_19)  # disabled

multiplication_8 = Multiplication(A=division_7, B=edge)  # disabled
multiplication_9 = Multiplication(A=division_8, B=edge)  # disabled

vec_2 = VectorXYZ(XComponent=division_6, YComponent=multiplication_8, ZComponent=multiplication_9)  # -> Vector, Length; disabled

# ---- group: MOV Z
move_22 = Move(
    Geometry=[move_20.Geometry, move_21.Geometry, move_19.Geometry, move_18.Geometry, move_15.Geometry, move_17.Geometry, move_16.Geometry, move_14.Geometry],
    Motion=vec_2.Vector)  # -> Geometry, Transform; disabled

# ----
move_23 = Move(Geometry=move_22.Geometry, Motion=vec_2.Vector)  # -> Geometry, Transform; disabled
move_24 = Move(Geometry=move_23.Geometry, Motion=vec_2.Vector)  # -> Geometry, Transform; disabled
